# Grasshopper definition nest_v3.gh (Grasshopper 1.0.7)

space_between_walls = Slider(0.35, range=0..1)
wall_height = Slider(59, range=1..100)
of_copies = Slider(4, range=0..10)
wall_thickness = Slider(1, range=0..3)
curve = Curve(<curve referenced from the Rhino model>)
vector = Vector(Vector(0, 0, 0))
linear_array = LinearArray(Geometry=curve, Direction=vector, Count=of_copies)  # -> Geometry, Transform
series = Series(Start=1, Step=space_between_walls, Count=of_copies)
unit_z = UnitZ(Factor=wall_height)
scale = Scale(Geometry=linear_array.Geometry, Center=Point(0, 0, 0), Factor=series)  # -> Geometry, Transform
offset_curve = OffsetCurve(Curve=scale.Geometry, Distance=wall_thickness, Plane=PlaneXY(0, 0, 0), Corners=1)
merge = Merge(Data1=graft(scale.Geometry), Data2=offset_curve)
taper_start = Slider(6.08, range=0..20)
infinte_toggle = BooleanToggle(True)
taper_end = Slider(20, range=0..20)
boundary_surfaces = BoundarySurfaces(Edges=merge)
extrude = Extrude(Base=boundary_surfaces, Direction=unit_z)
taper = Taper(
    Geometry=extrude,
    Axis=Line((0, 0, 0), (0, 0, 48)),
    Start=taper_start,
    End=taper_end,
    Flat=False,
    Infinite=infinte_toggle,
    Rigid=False)
