# Grasshopper definition rivet_v5.gh (Grasshopper 1.0.7)

along_x = Slider(0, range=0..20)
of_ridges_slider = Slider(16, range=0..20)
along_y = Slider(0, range=0..20)
along_y_2 = Slider(0, range=0..20)
along_x_2 = Slider(0, range=0..20)
after_baked_post = Brep(<brep referenced from the Rhino model>)
bracket = Brep(<brep referenced from the Rhino model>)
brep = Brep(<brep referenced from the Rhino model>)
series = Series(Start=0, Step=1, Count=of_ridges_slider)
box_array = BoxArray(
    Geometry=after_baked_post,
    Cell={Plane=PlaneXY(-15, 40, 0), X=Domain(0, 29), Y=Domain(0, 28), Z=Domain(0, 20)},
    XCount=along_x,
    YCount=along_y,
    ZCount=1)  # -> Geometry, Transform
brep_2 = Brep(<brep referenced from the Rhino model>)
brep_3 = Brep(<brep referenced from the Rhino model>)
box_array_2 = BoxArray(
    Geometry=bracket,
    Cell={Plane=PlaneXY(-14, 17, 0), X=Domain(0, 28), Y=Domain(0, 26), Z=Domain(0, 3)},
    XCount=along_x_2,
    YCount=along_y_2,
    ZCount=1)  # -> Geometry, Transform
series_2 = Series(Start=0, Step=1, Count=of_ridges_slider)
unit_z = UnitZ(Factor=series)
unit_z_2 = UnitZ(Factor=series_2)
move = Move(Geometry=brep, Motion=unit_z)  # -> Geometry, Transform
move_2 = Move(Geometry=brep_2, Motion=unit_z_2)  # -> Geometry, Transform
solid_union = SolidUnion(Breps=[brep_3, move.Geometry, move_2.Geometry])
